# Requirement set UAV_Requirements (R2025a)

## 1 [Stakeholder / Mission] (Container)

### 1.1 [REQ-001] Search capability
UAV shall locate missing persons in rural and urban environments

### 1.2 [REQ-002] Video streaming
UAV shall provide real-time video to ground operator

### 1.3 [REQ-003] Operator usability
UAV shall allow a single operator to control or monitor mission

## 2 [Performance] (Container)

### 2.1 [REQ-010] Endurance
UAV shall fly for at least 40 minutes on a single battery charge

### 2.2 [REQ-011] Cruise speed
UAV shall maintain a cruise speed between 15–20 m/s

### 2.3 [REQ-012] Max payload
UAV shall carry a payload of up to 2 kg

## 3 [Sensors & Data] (Container)

### 3.1 [REQ-020] Camera resolution
UAV camera shall detect a human-sized object at 100 m

### 3.2 [REQ-021] GPS accuracy
UAV GPS position shall be accurate within ±2 m

### 3.3 [REQ-022] Sensor redundancy
UAV shall have at least 1 backup IMU for attitude sensing

## 4 [Control & Autonomy] (Container)

### 4.1 [REQ-030] Manual control
UAV shall allow manual control of roll, pitch, yaw, and throttle

### 4.2 [REQ-031] Autonomous loiter
UAV shall loiter autonomously over a GPS waypoint

### 4.3 [REQ-032] Fail-safe behavior
UAV shall return-to-home within 5 seconds of GPS loss

## 5 [Safety & Reliability] (Container)

### 5.1 [REQ-040] Low battery landing
UAV shall automatically land safely when battery reaches 20%

### 5.2 [REQ-041] Geofencing
UAV shall not exit pre-defined operational boundaries

### 5.3 [REQ-042] Weather tolerance
UAV shall operate safely in winds up to 10 m/s and light rain